# Grasshopper definition ChairAsset.gh (Grasshopper 1.0.7)
# plug-ins: Bifocals, MeshEdit Components, Human

trigger = Trigger(Interval=50, TimerInterval=50, Target=data_recorder)
data_recorder = DataRecorder(Slider(1, range=0..1), DataLimit=-10, RecordData=True)
list_length = ListLength(List=data_recorder)
multiplication = Multiplication(A=list_length, B=Slider(0.01, range=0..0.1))
cosine = Cosine(Value=multiplication)
sine = Sine(Value=multiplication)
mesh = Mesh([<mesh referenced from the Rhino model> x13])
mesh_2 = Mesh([<mesh referenced from the Rhino model> x13])
mesh_3 = Mesh([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])
mesh_join = MeshJoin(Meshes=mesh_2)
panel = Panel(sine)
construct_point = ConstructPoint(XCoordinate=sine, YCoordinate=cosine, ZCoordinate=0)
mesh_area = MeshArea(Mesh=mesh_join)  # -> Area, Centroid
quad_sphere = QuadSphere(Base=mesh_area.Centroid, Radius=1)
deconstruct_brep = DeconstructBrep(Brep=quad_sphere)  # -> Faces, Edges, Vertices
evaluate_surface = EvaluateSurface(Surface=deconstruct_brep.Faces, Point=construct_point)  # -> Point, Normal, UDirection, VDirection, Frame
amplitude = Amplitude(Vector=evaluate_surface.Normal, Amplitude=Slider(3, range=0..10))
move = Move(Geometry=graft(mesh), Motion=graft([evaluate_surface.Normal, amplitude]))  # -> Geometry, Transform
mesh_area_2 = MeshArea(Mesh=move.Geometry)  # -> Area, Centroid
rotate_3d = Rotate3D(
    Geometry=graft(move.Geometry),
    Angle=1.570796327,
    Center=graft(mesh_area_2.Centroid),
    Axis=graft([evaluate_surface.Normal, amplitude]))  # -> Geometry, Transform
mesh_colours = MeshColours(Mesh=rotate_3d.Geometry, Colours=ColourSwatch(SwatchColor=RGB(128, 125, 82)))
bake_geometry = BakeGeometry(Bake=sine, Geometry=rotate_3d.Geometry, Attributes=mesh_colours, DeleteOldBakes=False, PreserveTrees=False)
