# Grasshopper definition ChairAsset_final.gh (Grasshopper 1.0.7)
# plug-ins: Bifocals, MeshEdit Components, Human, FologramForGrasshopper

trigger = Trigger(Interval=10, TimerInterval=10, Target=data_recorder)  # disabled
data_recorder = DataRecorder(Slider(0, range=0..1), DataLimit=-10, RecordData=True)  # disabled
list_length = ListLength(List=data_recorder)
multiplication = Multiplication(A=list_length, B=Slider(0.01, range=0..0.1))
cosine = Cosine(Value=multiplication)
sine = Sine(Value=multiplication)
mesh = Mesh(<mesh referenced from the Rhino model>)
mesh_2 = Mesh([<mesh referenced from the Rhino model> x124])
mesh_3 = Mesh([<mesh referenced from the Rhino model> x3])
mesh_4 = Mesh([<mesh referenced from the Rhino model> x3])
mesh_5 = Mesh(<mesh referenced from the Rhino model>)
mesh_6 = Mesh([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])
mesh_7 = Mesh([<mesh referenced from the Rhino model> x13])
mesh_8 = Mesh([<mesh referenced from the Rhino model> x13])
mesh_9 = Mesh([<mesh referenced from the Rhino model> x13])
mesh_10 = Mesh([<mesh referenced from the Rhino model> x13])
mesh_11 = Mesh(<mesh referenced from the Rhino model>)
mesh_12 = Mesh([<mesh referenced from the Rhino model> x23])
mesh_join = MeshJoin(Meshes=mesh)
mesh_join_2 = MeshJoin(Meshes=mesh_3)
mesh_join_3 = MeshJoin(Meshes=mesh_5)
mesh_join_4 = MeshJoin(Meshes=mesh_7)
mesh_join_5 = MeshJoin(Meshes=mesh_9)
mesh_join_6 = MeshJoin(Meshes=mesh_11)
construct_point = ConstructPoint(XCoordinate=sine, YCoordinate=cosine, ZCoordinate=0)
mesh_area = MeshArea(Mesh=mesh_join)  # -> Area, Centroid
mesh_area_2 = MeshArea(Mesh=mesh_join_2)  # -> Area, Centroid
mesh_area_3 = MeshArea(Mesh=mesh_join_4)  # -> Area, Centroid
mesh_area_4 = MeshArea(Mesh=mesh_join_3)  # -> Area, Centroid
mesh_area_5 = MeshArea(Mesh=mesh_join_5)  # -> Area, Centroid
mesh_area_6 = MeshArea(Mesh=mesh_join_6)  # -> Area, Centroid
quad_sphere = QuadSphere(Base=mesh_area.Centroid, Radius=1)
quad_sphere_2 = QuadSphere(Base=mesh_area_3.Centroid, Radius=1)
quad_sphere_3 = QuadSphere(Base=mesh_area_2.Centroid, Radius=1)
quad_sphere_4 = QuadSphere(Base=mesh_area_4.Centroid, Radius=1)
quad_sphere_5 = QuadSphere(Base=mesh_area_5.Centroid, Radius=1)
quad_sphere_6 = QuadSphere(Base=mesh_area_6.Centroid, Radius=1)
deconstruct_brep = DeconstructBrep(Brep=quad_sphere)  # -> Faces, Edges, Vertices
deconstruct_brep_2 = DeconstructBrep(Brep=quad_sphere_2)  # -> Faces, Edges, Vertices
deconstruct_brep_3 = DeconstructBrep(Brep=quad_sphere_3)  # -> Faces, Edges, Vertices
dispatch = Dispatch(List=deconstruct_brep_3.Faces, DispatchPattern=[True, False])  # -> ListA, ListB
deconstruct_brep_4 = DeconstructBrep(Brep=quad_sphere_4)  # -> Faces, Edges, Vertices
deconstruct_brep_5 = DeconstructBrep(Brep=quad_sphere_5)  # -> Faces, Edges, Vertices
deconstruct_brep_6 = DeconstructBrep(Brep=quad_sphere_6)  # -> Faces, Edges, Vertices
evaluate_surface = EvaluateSurface(Surface=deconstruct_brep.Faces, Point=construct_point)  # -> Point, Normal, UDirection, VDirection, Frame
evaluate_surface_2 = EvaluateSurface(Surface=deconstruct_brep_2.Faces, Point=construct_point)  # -> Point, Normal, UDirection, VDirection, Frame
evaluate_surface_3 = EvaluateSurface(Surface=dispatch.ListA, Point=construct_point)  # -> Point, Normal, UDirection, VDirection, Frame
evaluate_surface_4 = EvaluateSurface(Surface=deconstruct_brep_4.Faces, Point=construct_point)  # -> Point, Normal, UDirection, VDirection, Frame
evaluate_surface_5 = EvaluateSurface(Surface=deconstruct_brep_5.Faces, Point=construct_point)  # -> Point, Normal, UDirection, VDirection, Frame
evaluate_surface_6 = EvaluateSurface(Surface=deconstruct_brep_6.Faces, Point=construct_point)  # -> Point, Normal, UDirection, VDirection, Frame
amplitude = Amplitude(Vector=evaluate_surface_3.Normal, Amplitude=Slider(0.324, range=0..10))
amplitude_2 = Amplitude(Vector=evaluate_surface_5.Normal, Amplitude=Slider(2.427, range=0..10))
amplitude_3 = Amplitude(Vector=evaluate_surface_2.Normal, Amplitude=Slider(1.339, range=0..10))
move = Move(Geometry=graft(mesh_2), Motion=graft(evaluate_surface.Normal))  # -> Geometry, Transform
move_2 = Move(Geometry=graft(mesh_4), Motion=graft(amplitude))  # -> Geometry, Transform
move_3 = Move(Geometry=graft(mesh_6), Motion=graft(evaluate_surface_4.Normal))  # -> Geometry, Transform
range = Range(Domain="10", Steps="20")
move_4 = Move(Geometry=graft(mesh_8), Motion=graft([evaluate_surface_2.Normal, amplitude_3]))  # -> Geometry, Transform
panel = Panel("""1
2
3
4
5
6
7
8""")
move_5 = Move(Geometry=graft(mesh_12), Motion=graft(evaluate_surface_6.Normal))  # -> Geometry, Transform
move_6 = Move(Geometry=graft(mesh_10), Motion=graft([amplitude_2, evaluate_surface_5.Normal]))  # -> Geometry, Transform
panel_2 = Panel("""1
2
3""")
amplitude_4 = Amplitude(Vector=evaluate_surface.Normal, Amplitude=graft(range))
amplitude_5 = Amplitude(Vector=evaluate_surface_6.Normal, Amplitude=graft(panel_2))
mesh_area_7 = MeshArea(Mesh=move.Geometry)  # -> Area, Centroid
mesh_area_8 = MeshArea(Mesh=move_2.Geometry)  # -> Area, Centroid
mesh_area_9 = MeshArea(Mesh=move_3.Geometry)  # -> Area, Centroid
mesh_area_10 = MeshArea(Mesh=move_6.Geometry)  # -> Area, Centroid
mesh_area_11 = MeshArea(Mesh=move_5.Geometry)  # -> Area, Centroid
mesh_area_12 = MeshArea(Mesh=move_4.Geometry)  # -> Area, Centroid
rotate_3d = Rotate3D(
    Geometry=graft(move.Geometry),
    Angle=1.570796327,
    Center=graft(mesh_area_7.Centroid),
    Axis=graft([amplitude_4, evaluate_surface.Normal]))  # -> Geometry, Transform
rotate_3d_2 = Rotate3D(
    Geometry=graft(move_2.Geometry),
    Angle=1.570796327,
    Center=graft(mesh_area_8.Centroid),
    Axis=graft(evaluate_surface_3.Normal))  # -> Geometry, Transform
rotate_3d_3 = Rotate3D(
    Geometry=graft(move_3.Geometry),
    Angle=1.570796327,
    Center=graft(mesh_area_9.Centroid),
    Axis=graft(evaluate_surface_4.Normal))  # -> Geometry, Transform
rotate_3d_4 = Rotate3D(
    Geometry=graft(move_6.Geometry),
    Angle=1.570796327,
    Center=graft(mesh_area_10.Centroid),
    Axis=graft(evaluate_surface_5.Normal))  # -> Geometry, Transform
rotate_3d_5 = Rotate3D(
    Geometry=graft(move_5.Geometry),
    Angle=1.570796327,
    Center=graft(mesh_area_11.Centroid),
    Axis=graft([amplitude_5, evaluate_surface_6.Normal]))  # -> Geometry, Transform
rotate_3d_6 = Rotate3D(
    Geometry=graft(move_4.Geometry),
    Angle=1.570796327,
    Center=graft(mesh_area_12.Centroid),
    Axis=graft([evaluate_surface_2.Normal, amplitude_3]))  # -> Geometry, Transform
colour_swatch = ColourSwatch(SwatchColor=RGB(255, 231, 46))
mesh_colours = MeshColours(Mesh=rotate_3d_2.Geometry, Colours=colour_swatch)
mesh_colours_2 = MeshColours(Mesh=rotate_3d_3.Geometry, Colours=colour_swatch)
mesh_colours_3 = MeshColours(Mesh=rotate_3d_4.Geometry, Colours=colour_swatch)
mesh_colours_4 = MeshColours(Mesh=rotate_3d_6.Geometry, Colours=colour_swatch)
mesh_colours_5 = MeshColours(Mesh=rotate_3d_5.Geometry, Colours=colour_swatch)
mesh_colours_6 = MeshColours(Mesh=rotate_3d.Geometry, Colours=colour_swatch)
geometry = Geometry(mesh_colours_2)
stream_filter = StreamFilter(
    Gate=Slider(5, range=0..5),
    Stream0=mesh_colours_4,
    Stream1=geometry,
    Stream2=mesh_colours_3,
    Stream3=mesh_colours,
    Stream4=mesh_colours_5,
    Stream5=mesh_colours_6)
bake_geometry = BakeGeometry(Bake=sine, Geometry=rotate_3d_6.Geometry, Attributes=mesh_colours_4, DeleteOldBakes=False, PreserveTrees=False)
sync_object = SyncObject(
    GM=stream_filter,
    AlwaysIncludeTextureCoordinates=False,
    Clickable=False,
    DefaultCurveThicknessMillimeters=2.5,
    DefaultGlossPercent=0,
    DefaultMaterialColor=RGB(255, 255, 255),
    DefaultSpecularPercent=0,
    Grabbable=False,
    Interactive=False,
    Occlusion=False,
    Outline=False,
    hasSerializedData=True)  # disabled
